# Grasshopper definition joint_connector_generalized.gh (Grasshopper 1.0.7)
# plug-ins: EleFront, Weaverbird, Kangaroo2 Components, DendroGH

python = GhPythonScript()  # -> out, cd
# ---------- python: Python ----------
path = ghenv.Component.OnPingDocument().FilePath

separator = '/'
split = path.split(separator)
print split

if len(split) < 2:
    separator = '\\'
    split = path.split(separator)

cd = separator.join(split[:-3]) + separator + "mesh" + separator
# ---------- end python ----------
python_2 = GhPythonScript()  # -> out, cd
# ---------- python_2: Python ----------
__author__ = "ytakzk"
__version__ = "2018.12.04"

path = ghenv.Component.OnPingDocument().FilePath

separator = '/'
split = path.split(separator)
print split

if len(split) < 2:
    separator = '\\'
    split = path.split(separator)

cd = separator.join(split[:-1]) + separator
# ---------- end python_2 ----------
panel = Panel(python_2.cd)
panel_2 = Panel(python.cd)
python_script = PythonScript(cd=python.cd)  # -> out, vertices, faces
# ---------- python_script: Python ----------
import Rhino.Geometry as rg
file = open(cd + 'mesh.obj')
lines = file.readlines()
vertices=[]
faces=[]
for line in lines:
    if line.find("v")==0 and line.find("n")==-1 and line.find("t")==-1:
        print line.split(' ')
        vertices.Add(rg.Point3d(float((line.split(' '))[1]),float((line.split(' '))[2]),float((line.split(' '))[3])))
    if line.find("f")==0:
        if line.split(' ').Count==4:
            faces.Add(rg.MeshFace(int(line.split(' ')[1].split('/')[0])-1,int(line.split(' ')[2].split('/')[0])-1,int(line.split(' ')[3].split('/')[0])-1))
        if line.split(' ').Count==5:
            faces.Add(rg.MeshFace(int(line.split(' ')[1].split('/')[0])-1,int(line.split(' ')[2].split('/')[0])-1,int(line.split(' ')[3].split('/')[0])-1,int(line.split(' ')[4].split('/')[0])-1))
# ---------- end python_script ----------
construct_mesh = ConstructMesh(Vertices=python_script.vertices, Faces=python_script.faces)
mesh = Mesh(construct_mesh)

# ---- group: debug
node_index = Slider(4, range=0..100)
python_3 = GhPythonScript(m=mesh, x=node_index)  # -> out, pairs, vertices; inputs m: Mesh, x: Int32
# ---------- python_3: Python ----------
__author__ = "ytakzk"
__version__ = "2018.12.06"

import Rhino.Geometry as rg
import clr
clr.AddReference("Grasshopper")
import Grasshopper.Kernel.Data.GH_Path as ghpath
import Grasshopper.DataTree as datatree
import System

pairs = datatree[System.Object]()
vertices = datatree[System.Object]()

if x == "None":
    print " no vertex index given"
    x = 0

for i, v in enumerate(m.TopologyVertices, x):
    print i
    induces = m.TopologyVertices.ConnectedTopologyVertices(i)

    path = ghpath(i)

    for v in induces:
        vertex = m.TopologyVertices[v]
        pairs.Add(vertex, path)
    
    vertices.Add(m.TopologyVertices[i], path)
    
    if i == x:
        break
# ---------- end python_3 ----------

# ----
connection_tolerance_rod_to_joint = Slider(0.15, range=0.01..1)
joint_outer_radius_sphere = Slider(15, range=0..100)
rod_radius_cylinder = Slider(2, range=0.01..10)
python_4 = GhPythonScript(m=mesh)  # -> out, pairs, vertices; inputs m: Mesh
# ---------- python_4: Python ----------
__author__ = "ytakzk"
__version__ = "2018.12.06"

import Rhino.Geometry as rg
import clr
clr.AddReference("Grasshopper")
import Grasshopper.Kernel.Data.GH_Path as ghpath
import Grasshopper.DataTree as datatree
import System

pairs = datatree[System.Object]()
vertices = datatree[System.Object]()

for i, v in enumerate(m.TopologyVertices):
    
    induces = m.TopologyVertices.ConnectedTopologyVertices(i)

    path = ghpath(i)

    for v in induces:
        vertex = m.TopologyVertices[v]
        pairs.Add(vertex, path)
    
    vertices.Add(m.TopologyVertices[i], path)
# ---------- end python_4 ----------

# ---- group: size of the table
bbox = BoundingBox(Content=mesh, Plane=PlaneXY(0, 0, 0))  # -> Box, Box_2
debox = DeconstructBox(Box=bbox.Box)  # -> Plane, X, Y, Z
dedomain = DeconstructDomain(Domain=[debox.X, debox.Y, debox.Z])  # -> Start, End
subtraction = Subtraction(A=dedomain.End, B=dedomain.Start)
panel_3 = Panel(subtraction)

# ---- group: rods
medges = MeshEdges(Mesh=mesh)  # -> NakedEdges, InteriorEdges, NonManifoldEdges
merge = Merge(Data1=medges.NakedEdges, Data2=medges.InteriorEdges, Data3=medges.NonManifoldEdges)
pipe = Pipe(Curve=merge, Radius=rod_radius_cylinder, Caps=0)
cap = CapHoles(Brep=pipe)

# ----
ln = Line(StartPoint=python_4.pairs, EndPoint=python_4.vertices)
sph = Sphere(Base=python_4.vertices, Radius=joint_outer_radius_sphere)
crv = Curve(ln)
srf = Surface(sph)
len = Length(Curve=merge)
ma = MassAddition(Input=len)  # -> Result, PartialResults
scx = SurfaceCurve(Surface=srf, Curve=crv)  # -> Curves, Points, UVPoints, Normals, Parameters, Tangents
bar_graph = BarGraph(len, BarColor=RGB(255, 0, 90))
pshift = ShiftPaths(Data=scx.Points, Offset=-1)
pshift_2 = ShiftPaths(Data=scx.Normals, Offset=-1)
dist = Distance(PointA=pshift, PointB=python_4.vertices)
sph_2 = Sphere(Base=python_4.vertices, Radius=expr("x/2", joint_outer_radius_sphere))
division = Division(A=dist, B=Slider(2, range=0..10))
shift = ShiftList(List=pshift, Shift=1, Wrap=True)
srf_2 = Surface(sph_2)
geodesic = Geodesic(Surface=srf, Start=pshift, End=shift)
line = LineSDL(Start=pshift, Direction=expr("x*-1", pshift_2), Length=division)
planar = Planar(Curve=geodesic)  # -> Planar, Plane, Deviation

# ---- group: vizualization of the cuting planes
ln_2 = Line(StartPoint=pshift, EndPoint=shift)
eval = EvaluateCurve(Curve=reparameterize(ln_2), Parameter=0.5)  # -> Point, Tangent, Angle
pl_origin = PlaneOrigin(Base=planar.Plane, Origin=eval.Point)

# ----
sec = BrepPlane(Brep=srf_2, Plane=simplify(planar.Plane))  # -> Curves, Points
sec_2 = BrepPlane(Brep=srf, Plane=simplify(planar.Plane))  # -> Curves, Points
outter_stripe_width = Slider(6, range=2..10)
inner_stripe_width = Slider(3, range=2..10)
rod_holder_outer_radius_cylinder = Slider(3.5, range=0..10)
vsettings = CreateSettings(VoxelSize=Slider(0.4, range=0..1), Bandwidth=1, Isovalue=0.002, Adaptivity=0.1)
pshift_3 = ShiftPaths(Data=sec.Curves, Offset=-1)
item = ListItem(List=division, Index=0, Wrap=True)
addition = Addition(A=rod_radius_cylinder, B=connection_tolerance_rod_to_joint)
pshift_4 = ShiftPaths(Data=sec_2.Curves, Offset=-1)
popgeo = PopulateGeometry(Geometry=srf, Count=1, Seed=1, Points=pshift)
item_2 = ListItem(List=division, Index=0, Wrap=True)
vcurve = CurveToVolume(Curves=pshift_4, CurveRadius=expr("x/5", outter_stripe_width), Settings=vsettings)
vcurve_2 = CurveToVolume(Curves=pshift_4, CurveRadius=expr("x/2", outter_stripe_width), Settings=vsettings)
vcurve_3 = CurveToVolume(Curves=pshift_3, CurveRadius=expr("x/2", inner_stripe_width), Settings=vsettings)
vcurve_4 = CurveToVolume(Curves=line, CurveRadius=addition, Settings=vsettings)
vpoints = PointsToVolume(Points=python_4.vertices, PointRadius=joint_outer_radius_sphere, Settings=vsettings)
vcurve_5 = CurveToVolume(Curves=line, CurveRadius=rod_holder_outer_radius_cylinder, Settings=vsettings)
vpoints_2 = PointsToVolume(Points=python_4.vertices, PointRadius=item, Settings=vsettings)
sph_3 = Sphere(Base=python_4.vertices, Radius=item_2)
ln_3 = Line(StartPoint=python_4.vertices, EndPoint=popgeo)
srf_3 = Surface(sph_3)
vint = VolumeIntersection(VolumeA=vpoints, VolumesB=vcurve_2)
vint_2 = VolumeIntersection(VolumeA=vpoints, VolumesB=vcurve_5)
lng = ListLength(List=flatten(python_4.vertices))
scx_2 = SurfaceCurve(Surface=srf_3, Curve=ln_3)  # -> Curves, Points, UVPoints, Normals, Parameters, Tangents
series = Series(Start=0, Step=1, Count=lng)
pl = PlaneNormal(Origin=scx_2.Points, ZAxis=scx_2.Normals)
amp = Amplitude(Vector=scx_2.Normals, Amplitude=Slider(2, range=0..10))
vunion = VolumeUnion(Volumes=[vint_2, vpoints_2, vint, vcurve, vcurve_3])
move = Move(Geometry=pl, Motion=expr("-x", amp))  # -> Geometry, Transform
vsmooth = SmoothVolume(Volume=vunion, Width=Slider(1, range=0..10), Type=2, Iterations=1)
pshift_5 = ShiftPaths(Data=series, Offset=-1)  # -> simplify(graft(Data))
vdiff = VolumeDifference(VolumeA=vsmooth, VolumesB=vcurve_4)
vsmooth_2 = SmoothVolume(Volume=vdiff, Width=Slider(0.4, range=0..10), Type=2, Iterations=1)
text = DefineTextObject(Text=pshift_5, Plane=move.Geometry, DimensionStyle="Default02", OutputType="Curve")
scale = Scale(Geometry=text, Center=move.Geometry, Factor=Slider(7, range=0..10))  # -> simplify(Geometry), Transform
project = Project(Curve=scale.Geometry, Brep=srf_3, Direction=scx_2.Normals)  # -> simplify(Curve)
pshift_6 = ShiftPaths(Data=project, Offset=-1)
vcurve_6 = CurveToVolume(Curves=pshift_6, CurveRadius=Slider(0.8, range=0..1), Settings=vsettings)
vunion_2 = VolumeUnion(Volumes=[vsmooth_2, vcurve_6])
mvolume = VolumeToMesh(Volume=vunion_2, VolumeSettings=vsettings)
clean = CombineClean(Meshes=mvolume)
wblaplace = WeaverbirdsLaplacianSmoothing(MeshCurves=clean, Level=2, SmoothNakedEdges=1, Thin=1)  # disabled
