# Grasshopper definition workflow.gh (Grasshopper 1.0.4)
# plug-ins: LunchBox

python = GhPythonScript()  # -> out, cd
# ---------- python: Python ----------
__author__ = "ytakzk"
__version__ = "2018.12.04"

path = ghenv.Component.OnPingDocument().FilePath

separator = '/'
split = path.split(separator)

if len(split) < 2:
    separator = '\\'
    split = path.split(separator)

cd = separator.join(split[:-1]) + separator
# ---------- end python ----------
panel = Panel(python.cd)
# Run a Server
python_2 = GhPythonScript(python="C:\tools\Anaconda2\envs\python36\python.exe", cd=python.cd, port="9999", run=Toggle(True))  # -> out, s; inputs port: Int32, run: Boolean
# ---------- python_2: Python ----------
__author__ = "ytakzk"
__version__ = "2018.12.04"

import os
import threading
import time
import socket

TCP_IP   = '127.0.0.1'
TCP_PORT = 9999

def establish_server():
        
    command = 'cd %s && %s app.py -port %d' % (cd, python, port) 
    print(command)
    os.system(command)
    
if run:
    print('Run a server')
    t = threading.Thread(target=establish_server)
    t.start()
    
    time.sleep(2)
    
    s = socket.socket(socket.AF_INET, socket.SOCK_STREAM)
    s.connect((TCP_IP, TCP_PORT))
    s.settimeout(0.01)
# ---------- end python_2 ----------
# Model Selecion
python_3 = GhPythonScript(s=python_2.s, index=Slider(10, range=0..8400))  # -> out, succeeded; inputs index: Int32
# ---------- python_3: Python ----------
__author__ = "ytakzk"
__version__ = "2018.12.05"

import time
import socket

succeeded = False
if s:

    message = 'fetch_data__%d' % index
    s.send(message)
    
    i = 0
    while i < 300:
        try:
            data = s.recv(1024)
            
            if data == message:
                succeeded = True
                break
                
        except socket.timeout:
            pass
        i += 1
# ---------- end python_3 ----------
# Close Connection
python_4 = GhPythonScript(s=python_2.s, run=Button())  # -> out, a; inputs run: Boolean
# ---------- python_4: Python ----------
__author__ = "ytakzk"
__version__ = "2018.12.05"

if s and run:
    s.send('close__')
# ---------- end python_4 ----------
panel_2 = Panel(python_2.out)
panel_3 = Panel(python_2.s)
merge = Merge(
    Data1=Slider(0.2, range=-1..1),
    Data2=Slider(0, range=-1..1),
    Data3=Slider(0.1, range=-1..1),
    Data4=Slider(0, range=-1..1),
    Data5=Slider(0, range=-1..1))
# Manipulation
python_5 = GhPythonScript(s=python_2.s, succeeded=python_3.succeeded, diff_list=merge)  # -> out, succeeded; inputs succeeded: Boolean, diff_list: list
# ---------- python_5: Python ----------
__author__ = "ytakzk"
__version__ = "2018.12.05"

import socket

if s and succeeded:
    
    diff_str = ''
    for i, diff in enumerate(diff_list):
        diff_str += '%d:%.6f,' % (i, diff)
    diff_str = diff_str[:-1]

    message = 'manipulate__%s' % diff_str
    s.send(message)
    
    i = 0
    while i < 200:
        try:
            data = s.recv(1024)
            
            if data == message:
                succeeded = True
                print('succeeded')
                break
                
        except socket.timeout:
            pass
        i += 1
# ---------- end python_5 ----------
# Pointcloud to Mesh
python_6 = GhPythonScript(s=python_2.s, succeeded=python_5.succeeded)  # -> out, succeeded; inputs succeeded: Boolean
# ---------- python_6: Python ----------
__author__ = "ytakzk"
__version__ = "2018.12.05"

import socket

if s and succeeded:
    
    message = 'generate_mesh__'
    s.send(message)
    
    i = 0
    while i < 200:
        try:
            data = s.recv(1024)
            
            if data == message:
                succeeded = True
                print('succeeded')
                break
                
        except socket.timeout:
            pass
        i += 1
# ---------- end python_6 ----------
# Mesh Visualization
mesh_visualization = GhPythonScript(cd=python.cd, succeeded=python_6.succeeded)  # -> mesh; inputs succeeded: Boolean
# ---------- mesh_visualization: Python ----------
__author__ = "ytakzk"
__version__ = "2018.12.04"

import rhinoscriptsyntax as rs
import Rhino.Geometry as rg

if succeeded:

    path = cd + '/pointcloud2mesh/mount/output.off'

    with open(path, 'r') as file:
        
        vertices = []
        faces = []
        
        for i, l in enumerate(file):
            
            if i < 2:
                continue
                
            vals = l.split(' ')
            
            if len(vals) == 3:
                vals = [float(v) for v in vals]
                vertices.append(vals)
            elif len(vals) == 4:
                vals = [int(v) for v in vals[1:]]
                faces.append(vals)
                
        mesh = rs.AddMesh(vertices, faces)
# ---------- end mesh_visualization ----------
weld = WeldMesh(Mesh=mesh_visualization, Angle=3.141592654)
mesh = Mesh(weld)
unim = UnifyMesh(Mesh=mesh)  # -> Result, Count
mshreduce = MeshReduce(
    Mesh=unim.Result,
    TargetSize=Slider(100, range=0..1000),
    Distort=Toggle(True),
    Accuracy=Slider(5, range=0..10),
    NormalizeSize=Toggle(True))
preview = CustomPreview(Geometry=mshreduce, Material=ColourSwatch(SwatchColor=RGBA(36, 255, 167, 69)))
medges = MeshEdges(Mesh=mshreduce)  # -> NakedEdges, InteriorEdges, NonManifoldEdges
merge_2 = Merge(Data1=medges.NakedEdges, Data2=medges.InteriorEdges, Data3=medges.NonManifoldEdges)
